# Grasshopper definition parabolicTrussSystem.gh (Grasshopper 1.0.7)
# plug-ins: AxisVM, LunchBox

keretállások_száma = Slider(11, range=10..20)
number_slider = Slider(1, range=0..10)  # disabled
number_slider_2 = Slider(0.54, range=0..10)
number_slider_3 = Slider(9, range=0..10)  # disabled
axmembers = AxMembersAxisVM(Name="Szelemenek", Mat="S 235", CrossSection="80X 40X 4,0", Type="beam")

# ---- group: Keretállások
tartó_magasság = Slider(1, range=0..1)
belső_fesztávolság = Slider(43.4, range=40..46)
belső_magasság = Slider(13, range=12..21)
szegmensek_száma = Slider(40, range=0..100)
division = Division(A=belső_fesztávolság, B="2")
panel = Panel(division)
panel_2 = Panel(division)
dom = ConstructDomain(DomainStart=expr("-x", panel), DomainEnd=panel_2)
dom_2 = ConstructDomain(DomainStart="0", DomainEnd="1")
range = Range(Domain=dom, Steps=Slider(20, range=0..100))
remap = RemapNumbers(Value=range, Source=dom, Target=dom_2)  # -> Mapped, Clipped
graph = GraphMapper(remap.Mapped, x0=0, x1=1, y0=0, y1=1, Ox=0.5, Oy=1, Px=1, Py=0, container_name="Parabola")
panel_3 = Panel(belső_magasság)
multiplication = Multiplication(A=graph, B=panel_3)
X = UnitX(Factor=tartó_magasság)
pt = ConstructPoint(XCoordinate=range, YCoordinate=0, ZCoordinate=multiplication)
intcrv = Interpolate(Vertices=pt, Degree=3, Periodic=False, KnotStyle=1)  # -> Curve, Length, Domain
offset = OffsetCurve(Curve=intcrv.Curve, Distance=X, Plane=PlaneXY(0, 0, 0), Corners=1)
number_slider_4 = Slider(0, range=0..2)
truss = _2DTruss(CurveA=intcrv.Curve, CurveB=offset, Divisions=szegmensek_száma, TrussToggle=number_slider_4)  # -> PrimaryLines, BraceLines, VerticalLines, StructureNodes
övek = Line(truss.PrimaryLines)
ferde_rácsrudak = Line(truss.BraceLines)
normál_irányú_rácsrudak = Line(truss.VerticalLines)
series = Series(Start=0, Step=-1, Count=2)
item = ListItem(List=normál_irányú_rácsrudak, Index=series, Wrap=True)
cull_i = CullIndex(List=normál_irányú_rácsrudak, Indices=series, Wrap=True)

# ---- group: Szerkezeti elemek számításhoz szükséges hosszúságai
len = Length(Curve=[intcrv.Curve, offset])  # -> flatten(Length)
line = Line(truss.BraceLines)
line_2 = Line(truss.VerticalLines)
len_2 = Length(Curve=[line, line_2])
sug_irányú_és_ferde_rácsrudak_hosszai = Panel(len_2)
ma = MassAddition(Input=sug_irányú_és_ferde_rácsrudak_hosszai)  # -> Result, PartialResults
lng = ListLength(List=sug_irányú_és_ferde_rácsrudak_hosszai)
division_2 = Division(A=ma.Result, B=lng)
övek_hossza = Panel(len)
rácsrudak_össz_hossza = Panel(ma.Result)
átlós_rácsrudak_átlagos_hossza = Panel(division_2)

# ---- group: Rácsos szelemenek
number_slider_5 = Slider(0, range=0..10)  # disabled
keretállás_távolság = Slider(10, range=0..10)  # disabled
keretállások_száma_2 = Panel(keretállások_száma)  # disabled
merge = Merge(Data1=intcrv.Curve, Data2=offset)  # disabled
series_2 = Series(Start=number_slider_5, Step=keretállás_távolság, Count=keretállások_száma_2)  # disabled
Y = UnitY(Factor=series_2)  # disabled
divide = DivideCurve(Curve=flatten(merge), Count=szegmensek_száma, Kinks=False)  # -> Points, Tangents, Parameters; disabled
move = Move(Geometry=graft(divide.Points), Motion=Y)  # -> Geometry, Transform; disabled
series_3 = Series(Start=0, Step=1, Count=expr("x-1", keretállások_száma))  # disabled
item_2 = ListItem(List=move.Geometry, Index=expr("x+1", series_3), Wrap=True)  # disabled
item_3 = ListItem(List=move.Geometry, Index=series_3, Wrap=True)  # disabled
ln = Line(StartPoint=item_3, EndPoint=item_2)  # -> flatten(Line); disabled

# ----
points = PointList(Points=divide.Points, Size=number_slider)  # disabled
pt_2 = Point(truss.StructureNodes)
panel_4 = Panel(pt_2)
lng_2 = ListLength(List=pt_2)
flip = FlipMatrix(Data=pt_2)
split = SplitList(List=pt_2, Index=expr("x/2", lng_2))  # -> ListA, ListB
midpt = CurveMiddle(Curve=ln)  # disabled
lng_3 = ListLength(List=ln)  # disabled
dispatch = Dispatch(List=pt_2, DispatchPattern=[True, False])  # -> ListA, ListB

# ---- group: Szelemenek
keretállások_száma_3 = Panel(keretállások_száma)
keretállás_távolság_2 = Slider(10, range=0..10)
merge_2 = Merge(Data1=dispatch.ListA, Data2=dispatch.ListB)
series_4 = Series(Start=Slider(0, range=0..10), Step=keretállás_távolság_2, Count=keretállások_száma_3)
Y_2 = UnitY(Factor=series_4)
move_2 = Move(Geometry=graft(merge_2), Motion=Y_2)  # -> Geometry, Transform
series_5 = Series(Start=0, Step=1, Count=expr("x-1", keretállások_száma))
item_4 = ListItem(List=move_2.Geometry, Index=expr("x+1", series_5), Wrap=True)
item_5 = ListItem(List=move_2.Geometry, Index=series_5, Wrap=True)
ln_2 = Line(StartPoint=item_5, EndPoint=item_4)
szelemen = Line(flatten(ln_2))

# ---- group: Keretállások (continued)
crossref = CrossReference(ListA=övek, ListB=Y_2, CrossMode=1)  # -> ListA, ListB
crossref_2 = CrossReference(ListA=ferde_rácsrudak, ListB=Y_2, CrossMode=1)  # -> ListA, ListB
crossref_3 = CrossReference(ListA=cull_i, ListB=Y_2, CrossMode=1)  # -> ListA, ListB
crossref_4 = CrossReference(ListA=item, ListB=Y_2, CrossMode=1)  # -> ListA, ListB
move_3 = Move(Geometry=crossref.ListA, Motion=crossref.ListB)  # -> Geometry, Transform
move_4 = Move(Geometry=crossref_2.ListA, Motion=crossref_2.ListB)  # -> Geometry, Transform
move_5 = Move(Geometry=crossref_3.ListA, Motion=crossref_3.ListB)  # -> Geometry, Transform
move_6 = Move(Geometry=crossref_4.ListA, Motion=crossref_4.ListB)  # -> Geometry, Transform

# ---- group: Hosszirányú merevítés
merevített_csomópontok = ValueList({"Mind": 1, "Minden második": 2, "Minden harmadik": 3, "Minden negyedik": 4}, selected="Minden második")
x_rácsozás = BooleanToggle(True)
_1_merevítés_pozíciója = Slider(5, range=0..9)
_2_merevítés_pozíciója = Slider(4, range=0..9)
_3_merevítés_pozíciója = Slider(6, range=0..9)
_4_merevítés_pozíciója = Slider(3, range=0..9)
merevítések_száma = Slider(2, range=1..4)
series_6 = Series(Start=0, Step=1, Count=merevítések_száma)
merge_3 = Merge(Data1=_1_merevítés_pozíciója, Data2=_2_merevítés_pozíciója, Data3=_3_merevítés_pozíciója, Data4=_4_merevítés_pozíciója)
felső_öv = Curve(offset)
item_6 = ListItem(List=merge_3, Index=series_6, Wrap=True)
move_7 = Move(Geometry=felső_öv, Motion=Y_2)  # -> Geometry, Transform
item_7 = ListItem(List=move_7.Geometry, Index=expr("x+1", item_6), Wrap=True)
item_8 = ListItem(List=move_7.Geometry, Index=item_6, Wrap=True)
division_3 = Division(A=szegmensek_száma, B=merevített_csomópontok)
truss_2 = _2DTruss(CurveA=item_8, CurveB=item_7, Divisions=division_3, TrussToggle=number_slider_4)  # -> PrimaryLines, BraceLines, VerticalLines, graft(StructureNodes)
truss_3 = _2DTruss(CurveA=item_7, CurveB=item_8, Divisions=division_3, TrussToggle=number_slider_4)  # -> PrimaryLines, BraceLines, VerticalLines, graft(StructureNodes)
cull = CullPattern(List=truss_3.BraceLines, CullPattern=x_rácsozás)
merevítő_rudak = Line([truss_2.BraceLines, cull])

# ----
normál_irányú_rácsrudak_2 = Line(move_5.Geometry)
midpt_2 = CurveMiddle(Curve=ln_2)
points_2 = PointList(Points=midpt, Size=number_slider)  # disabled
points_3 = PointList(Points=midpt_2)
split_2 = SplitList(List=ln, Index=expr("x/2", lng_3))  # -> ListA, ListB; disabled
lng_4 = ListLength(List=szelemen)
points_4 = PointList(Points=dispatch.ListA, Size=number_slider_2)
points_5 = PointList(Points=dispatch.ListB, Size=number_slider_2)
split_3 = SplitList(List=szelemen, Index=expr("x/2", lng_4))  # -> ListA, ListB
truss_4 = _2DTruss(CurveA=split_2.ListA, CurveB=split_2.ListB, Divisions=number_slider_3, TrussToggle=number_slider_4)  # -> PrimaryLines, BraceLines, VerticalLines, graft(StructureNodes); disabled
truss_5 = _2DTruss(CurveA=split_3.ListA, CurveB=split_3.ListB, Divisions=Slider(9, range=0..10), TrussToggle=number_slider_4)  # -> PrimaryLines, BraceLines, VerticalLines, graft(StructureNodes)
szelemen_vertikális_rácsok = Line(flatten(truss_4.VerticalLines))  # disabled
szelemen_ferde_rácsok = Line(truss_4.BraceLines)  # disabled
szelemen_övek = Line([split_2.ListA, split_2.ListB])  # disabled
szelemen_alsó_övek = Line(split_3.ListA)
szelemen_felső_övek = Line(split_3.ListB)
szelemen_vertikális_rácsok_2 = Line(flatten(truss_5.VerticalLines))
szelemen_ferde_rácsok_2 = Line(truss_5.BraceLines)  # disabled

# ---- group: Axis
övek_2 = Line([move_3.Geometry, move_6.Geometry])
ferde_rácsrudak_2 = Line(move_4.Geometry)
normál_irányú_rácsrudak_3 = Line(normál_irányú_rácsrudak_2)
szelemen_2 = Line(flatten(szelemen_felső_övek))
merevítő_rudak_2 = Line(merevítő_rudak)
axmembers_2 = AxMembersAxisVM(Line=övek_2, Name="Övek", Mat="S 235", CrossSection="250X100X 6,0", Type="beam")
axmembers_3 = AxMembersAxisVM(Line=ferde_rácsrudak_2, Name="Ferde rácsrudak", Mat="S 235", CrossSection="50X 30X 3,0", Type="truss")
axmembers_4 = AxMembersAxisVM(Line=normál_irányú_rácsrudak_3, Name="Normál irányú rácsrudak", Mat="S 235", CrossSection="50X 30X 3,0", Type="truss")
axmembers_5 = AxMembersAxisVM(Line=szelemen_2, Name="Szelemenek", Mat="S 235", CrossSection="80X 40X 4,0", Type="truss")
axmembers_6 = AxMembersAxisVM(Line=flatten(merevítő_rudak_2), Name="Szelemenek", Mat="S 235", CrossSection="80X 40X 4,0", Type="truss")
axmember = AxMemberParameter(flatten([axmembers_2, axmembers_3, axmembers_4, axmembers_5, axmembers_6, axmembers]))
membtoaxisvm = SendMembersToAxisVM(AxisVMMember=axmember)
